# Dynamo graph unit area naming.dyn (Dynamo 0.9.0.3067)

code_block = CodeBlock { "b.Unit Token"; }
byName = Family.ByName(code_block)
types = Family.Types(byName)
name = FamilyType.Name(types)
categories = Categories("Areas")
all_elements_of_category = ElementsOfCategory(categories)
code_block_2 = CodeBlock { "Name"; }
boundaries = Custom[Room.Boundaries](room=all_elements_of_category)  # Gets a list of all boundary elements of a given room or area
endPoint = Curve.EndPoint()
map = List.Map(list=boundaries.curves, f_x=endPoint)
startPoint = Curve.StartPoint()
map_2 = List.Map(list=boundaries.curves, f_x=startPoint)
join = List.Join(map, map_2)
uniqueItems = List.UniqueItems(join)
byPerimeterPoints = Surface.ByPerimeterPoints(uniqueItems)
number = DoubleInput(8)
thicken = Surface.Thicken(surface=byPerimeterPoints, thickness=number)
all_elements_of_family_type = ElementsOfFamilyType(types)
flatten = Flatten(all_elements_of_family_type)
location = FamilyInstance.Location(flatten)
ZAxis = Vector.ZAxis()
number_2 = DoubleInput(7.5)
scale = Vector.Scale(vector=ZAxis, scale_factor=number_2)
add = Point.Add(point=location, vectorToAdd=scale)
doesIntersect = Geometry.DoesIntersect(geometry=thicken, other=add, lacing=CrossProduct)
boolean = BoolSelector(true)
firstIndexOf = List.FirstIndexOf(item=boolean)
map_3 = List.Map(list=doesIntersect, f_x=firstIndexOf)
name_2 = Element.Name(flatten)
toUpper = String.ToUpper(name_2)
getItemAtIndex = List.GetItemAtIndex(list=toUpper)
map_4 = List.Map(list=map_3, f_x=getItemAtIndex)
isNull = Object.IsNull(map_4)
getParameterValueByName = Element.GetParameterValueByName(element=all_elements_of_category, parameterName=code_block_2)
if_ = If(test=isNull, true=getParameterValueByName, false=map_4)
setParameterByName = Element.SetParameterByName(element=all_elements_of_category, parameterName=code_block_2, value=if_)
code_block_3 = CodeBlock { "Areas"; }
byName_2 = Category.ByName(code_block_3)
string = StringInput("Areas")
