# Dynamo graph unit naming.dyn (Dynamo 0.9.0.3067)

code_block = CodeBlock { "b.Unit Token"; }
byName = Family.ByName(code_block)
types = Family.Types(byName)
name = FamilyType.Name(types)
categories = Categories("Rooms")
all_elements_of_category = ElementsOfCategory(categories)
geometry = Element.Geometry(all_elements_of_category)
code_block_2 = CodeBlock { 1; }
flatten = List.Flatten(list=geometry, amt=code_block_2)
all_elements_of_family_type = ElementsOfFamilyType(types)
flatten_2 = Flatten(all_elements_of_family_type)
location = FamilyInstance.Location(flatten_2)
ZAxis = Vector.ZAxis()
add = Point.Add(point=location, vectorToAdd=ZAxis)
doesIntersect = Geometry.DoesIntersect(geometry=flatten, other=add, lacing=CrossProduct)
boolean = BoolSelector(true)
firstIndexOf = List.FirstIndexOf(item=boolean)
map = List.Map(list=doesIntersect, f_x=firstIndexOf)
name_2 = Element.Name(flatten_2)
getItemAtIndex = List.GetItemAtIndex(list=name_2)
map_2 = List.Map(list=map, f_x=getItemAtIndex)
