# Dynamo graph units.dyn (Dynamo 0.9.0.3067)

element_types = ElementTypes("Group")
all_elements_of_type = ElementsOfType(element_types)
get_type_of_group = Python(IN[0]=all_elements_of_type)
# ---------- get_type_of_group.python (14 lines) ----------
import clr
clr.AddReference('ProtoGeometry')
from Autodesk.DesignScript.Geometry import *
#The inputs to this node will be stored as a list in the IN variables.
dataEnteringNode = IN

items = UnwrapElement(IN[0])
grouplist = list()

for item in items:
	grouplist.append(item.GroupType)

#Assign your output to the OUT variable.
OUT = grouplist
# ----------------------------------------
name = Element.Name(get_type_of_group)
element_types_2 = ElementTypes("GroupType")
all_elements_of_type_2 = ElementsOfType(element_types_2)
name_2 = Element.Name(all_elements_of_type_2)
allIndicesOf = List.AllIndicesOf(list=name, item=name_2)
count = List.Count()
map = List.Map(list=allIndicesOf, f_x=count)
firstIndexOf = List.FirstIndexOf(list=name, item=name_2)
getItemAtIndex = List.GetItemAtIndex(list=all_elements_of_type, index=firstIndexOf)
get_group_members = Python(IN[0]=getItemAtIndex)
# ---------- get_group_members.python (9 lines) ----------
import clr
dataEnteringNode = IN

groups = UnwrapElement(IN[0])
groupMemberList = list()
for group in groups:
	groupMemberList.append(group.GetMemberIds())

OUT = groupMemberList
# ----------------------------------------
get_elements_by_id = Python(IN[0]=get_group_members)
# ---------- get_elements_by_id.python (26 lines) ----------
import clr
dataEnteringNode = IN

clr.AddReference('RevitAPI')
from Autodesk.Revit.DB import *
clr.AddReference("RevitNodes")
import Revit
clr.ImportExtensions(Revit.Elements)
clr.AddReference("RevitServices")
import RevitServices
from RevitServices.Persistence import DocumentManager

doc = DocumentManager.Instance.CurrentDBDocument
groups = UnwrapElement(IN[0])

grouplist = list()
for group in groups:
	memberlist = list()
	for member in group:
		element = doc.GetElement(member)
		#memberlist.append(element.GetType())
		if element is Autodesk.Revit.DB.ModelLine:
			memberlist.append(doc.GetElement(member))
	grouplist.append(memberlist)
	
OUT = grouplist
# ----------------------------------------
element_types_3 = ElementTypes("ModelCurve")
